# Grasshopper definition Hops leo.gh (Grasshopper 1.0.7)

get_geometry = GetGeometry(AtLeast=1, AtMost=1, DeleteInput=False, Filter=1074004029)
get_number = GetNumber(AtLeast=1, AtMost=1, Maximum=1.797693135e+308, Minimum=-1.797693135e+308)
N = Count(50)
divide = DivideCurve(Curve=get_geometry, Count=N, Kinks=False)  # -> Points, Tangents, Parameters
series = Series(Start=0, Step=get_number, Count=N)
Z = UnitZ(Factor=series)
move = Move(Geometry=divide.Points, Motion=Z)  # -> Geometry, Transform
context_bake = ContextBake(Geometry=move.Geometry)
