# Grasshopper definition test_hops.gh (Grasshopper 1.0.7)

curves = GetGeometry(AtLeast=1, AtMost=1, DeleteInput=False, Filter=1074004028)
count = GetInteger(AtLeast=1, AtMost=1, Maximum=2147483647, Minimum=-2147483648)
divide = DivideCurve(Curve=curves, Count=count, Kinks=False)  # -> Points, Tangents, Parameters
rev = ReverseList(List=divide.Points)
ln = Line(StartPoint=divide.Points, EndPoint=rev)
context_bake = ContextBake(Geometry=ln)
